# Grasshopper definition 0126orthogonal00.gh (Grasshopper 1.0.7)

# 정점 갯수 홀수
pt = Point([Point(-1040, -1090, 0), Point(460, -880, 0), Point(950, -710, 1200), Point(2520, -740, 1200), Point(2259.114413, 1049.984045, 2355.128687), Point(2625.59689, 950, 2823.415753), Point(2800, 2280, 2690), Point(4970, 2280, 2690), Point(5310, 2190, 4550)])
# 정점 갯수 짝수
pt_2 = Point([Point(-1040, -1090, 0), Point(460, -880, 0), Point(950, -710, 1200), Point(2520, -740, 1200), Point(2259.114413, 1049.984045, 1364.275147), Point(2625.59689, 950, 2823.415753), Point(2800, 2280, 2690), Point(4970, 2280, 2690), Point(5310, 2190, 4550)])
pline = PolyLine(Vertices=pt, Closed=False)
split = SplitList(List=pt_2, Index=8)  # -> ListA, ListB
explode = Explode(Curve=pline, Recursive=True)  # -> Segments, Vertices
pt_3 = Point(split.ListA)
lng = ListLength(List=pt_3)
lng_2 = ListLength(List=explode.Vertices)
division = Division(A=lng, B=2)
mod = Modulus(A=lng_2, B=2)
division_2 = Division(A=lng_2, B=2)
split_2 = SplitList(List=pt_3, Index=division)  # -> ListA, ListB
dispatch = Dispatch(List=explode.Vertices, DispatchPattern=mod)  # -> ListA, ListB
round = Round(Number=division_2)  # -> Nearest, Floor, Ceiling
split_3 = SplitList(List=split_2.ListB, Index=1)  # -> ListA, ListB

pt_4 = Point(split_2.ListA)
pt_5 = Point(split_3.ListA)
pt_6 = Point(split_3.ListB)

rev = ReverseList(List=dispatch.ListA)
item = ListItem(List=explode.Vertices, Index=round.Floor, Wrap=True)
split_4 = SplitList(List=dispatch.ListA, Index=round.Floor)  # -> ListA, ListB
split_5 = SplitList(List=rev, Index=round.Floor)  # -> ListA, ListB

pt_7 = Point(split_5.ListA)
pt_8 = Point(item)
pt_9 = Point(split_4.ListA)

item_2 = ListItem(List=split_5.ListA, Index=0, Wrap=True)  # -> Item, Item1, Item2, Item3
# xyz 중 가장 차이가 적은 값 수정
item_3 = ListItem(List=split_4.ListA, Index=0, Wrap=True)  # -> Item, Item1, Item2, Item3
cluster = Cluster(P=item_2.Item, P_2=item_2.Item1)
cluster_2 = Cluster(P=item_3.Item, P_2=item_3.Item1)
cluster_3 = Cluster_2(P_2=cluster_2, P=item_3.Item2)
cluster_4 = Cluster_2(P_2=cluster, P=item_2.Item2)
cluster_5 = Cluster_2(P_2=cluster_3, P=item_3.Item3)
cluster_6 = Cluster_2(P_2=cluster_4, P=item_2.Item3)
bbox = BoundingBox(Content=[cluster_5, cluster_6], Plane=PlaneXY(0, 0, 0), UnionBox=True)  # -> Box, Box_2
# x,y,z 모두 다를 경우
# 한 좌표가 같을 경우
# 두 좌표가 같을 경우
# x,y,z 좌표가 모두 같을 경우
debrep = DeconstructBrep(Brep=bbox.Box)  # -> Faces, Edges, Vertices
equals = Equality(FirstNumber=debrep.Vertices, SecondNumber=cluster_5)  # -> Equality, Inequality
cull = CullPattern(List=debrep.Vertices, CullPattern=equals.Inequality)
equals_2 = Equality(FirstNumber=cull, SecondNumber=cluster_6)  # -> Equality, Inequality
cull_2 = CullPattern(List=cull, CullPattern=equals_2.Inequality)
pdecon = Deconstruct(Point=item_3.Item)  # -> XComponent, YComponent, ZComponent
pdecon_2 = Deconstruct(Point=item_3.Item1)  # -> XComponent, YComponent, ZComponent
cp = ClosestPoint(Point=pt_8, Cloud=cull_2)  # -> ClosestPoint, CPIndex, Distance
bbox_2 = BoundingBox(Content=flatten([item_3.Item3, pt_8]), Plane=PlaneXY(0, 0, 0), UnionBox=True)  # -> Box, Box_2
bbox_3 = BoundingBox(Content=[item_3.Item, item_3.Item1], Plane=PlaneXY(0, 0, 0), UnionBox=True)  # -> Box, Box_2
bbox_4 = BoundingBox(Content=[item_3.Item1, item_3.Item2], Plane=PlaneXY(0, 0, 0), UnionBox=True)  # -> Box, Box_2
bbox_5 = BoundingBox(Content=[item_3.Item2, item_3.Item3], Plane=PlaneXY(0, 0, 0), UnionBox=True)  # -> Box, Box_2
replace = ReplaceItems(List=cull_2, Indices=cp.CPIndex, Wrap=False)
edges = BrepEdges(Brep=bbox_5.Box)  # -> Naked, Interior, NonManifold
edges_2 = BrepEdges(Brep=bbox_3.Box)  # -> Naked, Interior, NonManifold
edges_3 = BrepEdges(Brep=bbox_4.Box)  # -> Naked, Interior, NonManifold
edges_4 = BrepEdges(Brep=bbox_2.Box)  # -> Naked, Interior, NonManifold
subtraction = Subtraction(A=pdecon.XComponent, B=pdecon_2.XComponent)
subtraction_2 = Subtraction(A=pdecon.YComponent, B=pdecon_2.YComponent)
subtraction_3 = Subtraction(A=pdecon.ZComponent, B=pdecon_2.ZComponent)
clean = CleanTree(RemoveNulls=True, RemoveInvalid=True, RemoveEmpty=False, Tree=replace)
abs = Absolute(Value=subtraction)
abs_2 = Absolute(Value=subtraction_2)
abs_3 = Absolute(Value=subtraction_3)
cp_2 = ClosestPoint(Point=pt_8, Cloud=clean)  # -> ClosestPoint, CPIndex, Distance
explode_2 = Explode(Recursive=True)  # -> Segments, Vertices
merge = Merge(Data1=cp.ClosestPoint, Data2=cp_2.ClosestPoint)  # -> flatten(Result)
cp_3 = ClosestPoint(Point=cluster_5, Cloud=merge)  # -> ClosestPoint, CPIndex, Distance
cp_4 = ClosestPoint(Point=cluster_6, Cloud=merge)  # -> ClosestPoint, CPIndex, Distance
merge_2 = Merge(Data1=item_3.Item, Data2=cluster_2, Data3=cluster_3, Data4=cluster_5, Data5=cp_3.ClosestPoint)  # -> flatten(Result)
merge_3 = Merge(Data1=item_2.Item, Data2=cluster, Data3=cluster_4, Data4=cluster_6, Data5=cp_4.ClosestPoint)  # -> flatten(Result)
rev_2 = ReverseList(List=merge_3)
merge_4 = Merge(Data1=merge_2, Data2=rev_2)
pline_2 = PolyLine(Vertices=merge_4, Closed=False)

# ==== cluster Cluster
P = ClusterInput()
P_2 = ClusterInput()
pdecon = Deconstruct(Point=P)  # -> XComponent, YComponent, ZComponent
pdecon_2 = Deconstruct(Point=P_2)  # -> XComponent, YComponent, ZComponent
subtraction = Subtraction(A=pdecon.XComponent, B=pdecon_2.XComponent)
subtraction_2 = Subtraction(A=pdecon.YComponent, B=pdecon_2.YComponent)
subtraction_3 = Subtraction(A=pdecon.ZComponent, B=pdecon_2.ZComponent)
abs = Absolute(Value=subtraction)
abs_2 = Absolute(Value=subtraction_2)
abs_3 = Absolute(Value=subtraction_3)
python = GhPythonScript(x=abs, y=abs_2, z=abs_3)  # -> out, a
# ---------- python: Python ----------
__author__ = "SLZ_D03"
__version__ = "2023.01.25"

import rhinoscriptsyntax as rs


a = max(x,y,z)
# ---------- end python ----------
equals = Equality(FirstNumber=abs, SecondNumber=python.a)  # -> Equality, Inequality
equals_2 = Equality(FirstNumber=abs_2, SecondNumber=python.a)  # -> Equality, Inequality
equals_3 = Equality(FirstNumber=abs_3, SecondNumber=python.a)  # -> Equality, Inequality
dispatch = Dispatch(List=pdecon.XComponent, DispatchPattern=equals.Inequality)  # -> ListA, ListB
dispatch_2 = Dispatch(List=pdecon_2.XComponent, DispatchPattern=equals.Equality)  # -> ListA, ListB
dispatch_3 = Dispatch(List=pdecon.YComponent, DispatchPattern=equals_2.Inequality)  # -> ListA, ListB
dispatch_4 = Dispatch(List=pdecon_2.YComponent, DispatchPattern=equals_2.Equality)  # -> ListA, ListB
dispatch_5 = Dispatch(List=pdecon.ZComponent, DispatchPattern=equals_3.Inequality)  # -> ListA, ListB
dispatch_6 = Dispatch(List=pdecon_2.ZComponent, DispatchPattern=equals_3.Equality)  # -> ListA, ListB
merge = Merge(Data1=dispatch.ListA, Data2=dispatch_2.ListA)
merge_2 = Merge(Data1=dispatch_3.ListA, Data2=dispatch_4.ListA)
merge_3 = Merge(Data1=dispatch_5.ListA, Data2=dispatch_6.ListA)
pt = ConstructPoint(XCoordinate=merge, YCoordinate=merge_2, ZCoordinate=merge_3)
pt_2 = ClusterOutput(pt)

# ==== cluster Cluster_2
P = ClusterInput()
P_2 = ClusterInput()
pdecon = Deconstruct(Point=P)  # -> XComponent, YComponent, ZComponent
pdecon_2 = Deconstruct(Point=P_2)  # -> XComponent, YComponent, ZComponent
subtraction = Subtraction(A=pdecon_2.XComponent, B=pdecon.XComponent)
subtraction_2 = Subtraction(A=pdecon_2.YComponent, B=pdecon.YComponent)
subtraction_3 = Subtraction(A=pdecon_2.ZComponent, B=pdecon.ZComponent)
abs = Absolute(Value=subtraction)
abs_2 = Absolute(Value=subtraction_2)
abs_3 = Absolute(Value=subtraction_3)
python = GhPythonScript(x=abs, y=abs_2, z=abs_3)  # -> out, a; same code as python
equals = Equality(FirstNumber=abs, SecondNumber=python.a)  # -> Equality, Inequality
equals_2 = Equality(FirstNumber=abs_2, SecondNumber=python.a)  # -> Equality, Inequality
equals_3 = Equality(FirstNumber=abs_3, SecondNumber=python.a)  # -> Equality, Inequality
dispatch = Dispatch(List=pdecon_2.XComponent, DispatchPattern=equals.Inequality)  # -> ListA, ListB
dispatch_2 = Dispatch(List=pdecon.XComponent, DispatchPattern=equals.Equality)  # -> ListA, ListB
dispatch_3 = Dispatch(List=pdecon_2.YComponent, DispatchPattern=equals_2.Inequality)  # -> ListA, ListB
dispatch_4 = Dispatch(List=pdecon.YComponent, DispatchPattern=equals_2.Equality)  # -> ListA, ListB
dispatch_5 = Dispatch(List=pdecon_2.ZComponent, DispatchPattern=equals_3.Inequality)  # -> ListA, ListB
dispatch_6 = Dispatch(List=pdecon.ZComponent, DispatchPattern=equals_3.Equality)  # -> ListA, ListB
merge = Merge(Data1=dispatch.ListA, Data2=dispatch_2.ListA)
merge_2 = Merge(Data1=dispatch_3.ListA, Data2=dispatch_4.ListA)
merge_3 = Merge(Data1=dispatch_5.ListA, Data2=dispatch_6.ListA)
pt = ConstructPoint(XCoordinate=merge, YCoordinate=merge_2, ZCoordinate=merge_3)
pt_2 = ClusterOutput(pt)
